vi "Main.Lab.gviweb"   [LabVIEW NXG 5.0.0]
panel controls:
  "Connecting Solar Panels": i32 = -1
  "Solar panel tilt angle, º": f64
  "Power setting for the light source, W": f64
  "Cooling conditions": i32 = -1
  "Clear/ Tab 1": bool
  "Isc": f64
  "Uoc": f64
  "Clear Graph Tab 4": bool
  "Save in memory": bool
  "Slot Name": string
  "Slot Number": i32 = "Slot 1"(0)
  "Imp": f64
  "Ump": f64
  "FF/Calculation": bool
  "Add to table Tab 4": bool
  "Calculate Tab 1": bool
  "T1": f64
  "T2": f64
  "Uoc/Calculation_3": f64
  "Uoc2": f64
  "Kt/Calculation": bool
  "Dimming conditions": i32 = -1
  "Parallel connection": i32 = -1
  "Series connection": i32 = -1
  "Heating conditions": i32 = -1
  "1х, Ohm": i32[]
  "10х": i32[]
  "100х": i32[]
  "Set Load": bool
  "Calculate average": bool
  "Parameter Y": i32 = -1
  "Parameter X": i32 = -1
  "Calculation": i32
  "1000х": i32[]
  "History Graph V/Measurment": i16 = 400
  "History Graph I/Measurment": i16 = 400
  "History Graph T/Measurment": i16 = 400
  "Clear All Memory": bool
  "Clear Table Tab 4": bool
  "Slot number/Read/": i32 = "1"(0)
  "Manual/Automatic": enum{"Manual", "Automatic"} = "Manual"
  "Show Graph Tab 4": bool
  "Clear Memory": bool
  "Slot number Tab 1": i32 = "1"(0)
  "Calc/Slot number2.1": i32 = "1"(0)
  "Show / Hide Graph 1": bool
  "Delete Last Tab 4": bool
  "Change History J/Measurment": i32
  "History Graph R/Measurment": i16 = 400
  "History Graph J/Measurment": i16 = 400
  "Show / Hide Graph 2": bool
  "Calc/Slot number2.2": i32 = "1"(0)
  "Calc/Slot number2.3": i32 = "1"(0)
  "Calc/Slot number2.4": i32 = "1"(0)
  "Show / Hide Graph 3": bool
  "Show / Hide Graph 4": bool
  "Input Data": f64[][] = [[1.814, 0.0233, 27.1, 0, 500, 70], [1.802, 0.069, 26.11, 0, 500, 75], [1.794, 0.109, 16.45, 0, 500, 73], [1.792, 0.151, 11.86, 0, 500, 72], [1.78, 0.192, 9.27, 0, 500, 73], [1.773, 0.231, 7.5, 0, 500, 0], [1.765, 0.273, 6.46, 0, 500, 0], [1.762, 0.315, 5.59, 0, 500, 0], [1.754, 0.358, 4.89, 0, 500, 0], [1.734, 0.399, 4.34, 0, 500, 0], [1.725, 0.439, 3.78, 0, 500, 0], [1.721, 0.48, 3.54, 0, 500, 0], [1.711, 0.521, 3.15, 0, 500, 0], [1.688, 0.561, 3.01, 0, 500, 0], [1.667, 0.602, 2.7, 0, 500, 0], [1.657, 0.636, 2.59, 0, 500, 0], [1.648, 0.678, 2.32, 0, 500, 0], [1.613, 0.718, 2.1, 0, 500, 0], [1.244, 0.761, 1.64, 0, 500, 0], [0.461, 0.793, 0.58, 0, 500, 0], [0.016, 0.798, 0.02, 0, 500, 0]]
  "X": f64
  "Y": f64
  "Stop": bool
  "error in": error
  "error in_2": error
  "error in_3": error
panel indicators:
  "Start/Stop lab": bool
  "Refresh": bool
  "Lab Manual": bool
  "Graph Voltage": f64[]
  "Clear Graph V/Measurment": bool
  "Change history V/Measurment": bool
  "Isc/Calculation": bool
  "Uoc/Calculation": bool
  "Graph Tab 4": cluster{"Element 1": f64[], "Element 2": f64[]}
  "Print Page": bool
  "Slot name": string
  "Imp/Calculation": bool
  "Ump/Calculation": bool
  "FF": f64
  "Graph 1 Tab 3": T1[]
  "Graph 2 Tab 3": cluster{"Element 1": f64[], "Element 2": f64[]}[]
  "T1/Calclation": bool
  "T2/Calculation": bool
  "Uoc1/Calculation": bool
  "Uoc2/Calculation": bool
  "Kt": f64
  "Total Load, Ohm": i32
  "URL Image_2": string
  "URL Image_3": string
  "Graph Current": f64[]
  "Clear Graph I/Measurment": bool
  "Graph Temperature": f64[]
  "Clear Graph T/Measurment": bool
  "Change History I/Measurment": bool
  "Change History T/Measurment": bool
  "URL Image_4": string
  "Memory Slot": string[]
  "Read Slot Name": string
  "URL Image_5": string
  "LED": bool
  "button_38": bool
  "Table/Measurment": f64[][]
  "URL Image_6": string
  "URL Image_7": string
  "Graph Tab 1": T1[]
  "Web Camera": string
  "Temperature, ºC": f64
  "Delete Last": bool
  "Slot name2.1": string
  "Slot name2.2": string
  "Slot name2.3": string
  "Update Display": string
  "Graph Load": f64[]
  "Clear Graph R/Measurment": bool
  "Change History R/Measurment": bool
  "Graph_10": f64[]
  "Clear Graph J/Measurment": bool
  "Change History J/Measurment_2": bool
  "Table Measurments": f64[][]
  "Headers/Calculation": string[]
  "Slot name2.4": string
  "Headers/Measurment": string[]
  "Intensity, W/m2": f64
  "Panel tilt angle, º": f64
  "Angle of rotation 1, º": f64
  "Angle of rotation 1, º_2": f64
  "Table/Avarage": f64[][]
  "Table Tab 4": f64[][]
  "Header XY": string[]
  "Table Tab 4_2": f64[][]
  "error out": error
  "error out_2": error
  "error out_3": error
types:
  T1 = cluster{"Element 1": cluster{"Element 1": f64, "Element 2": f64}[]}
uses:
  NI::Skyline::Configuration::Open Configuration.gvi
  NI::Skyline::TagHTTP::Query Tags.gvi
  NI::Skyline::TagHTTP::Open Tag.gvi
  NI::Skyline::TagHTTP::Read Tag (DBL).gvi
  NI::Skyline::TagHTTP::Close Tag (Single).gvi
  NI::Skyline::Configuration::Close Configuration.gvi
  NI::Skyline::TagHTTP::Write Tag (DBL).gvi
  NI::Skyline::MessageHTTP::Open.gvi
  NI::Skyline::MessageHTTP::Publish.gvi
  NI::Skyline::MessageHTTP::Flush.gvi
  NI::Skyline::MessageHTTP::Subscribe.gvi
  NI::Skyline::MessageHTTP::Read.gvi
  NI::Skyline::MessageHTTP::Unsubscribe.gvi
  WebApp::Support::Message Queue::Create All Message Queues.gvi
  WebApp::Support::Message Queue::Enqueue Message (Single).gvi
  WebApp::Support::Message Queue::Dequeue Message.gvi
  WebApp::Memory Buffer::Memory buffer.gvi
  WebApp::Custom Chart::Custom Chart.gvi
  WebApp::Load Selection::Load selection.gvi
diagram:
  while {
    Wait(time to wait=200)
    call "Open Configuration.gvi"(server url="http://localhost:80", username="admin", password="w", error in=$"error in_2") -> (configuration=w1, error out=w2)
    w3 = ["temperature indicator", "intensity indicator", "angle indicator"]
    call "Query Tags.gvi"(paths=w3, error in=w2, configuration=w1) -> (tags=w4, error out=w5)
    for {
      w6 = each element of w4
      Wait(time to wait=400)
      Property Node(instance in=w6) -> ("Path"=w8, "Datatype"=w9)
      call "Open Tag.gvi"(path=w8, data type=w9, error in=w5, configuration=w1) -> (tag=w10, error out=w11)
      call "Read Tag (DBL).gvi"(tag in=w10, error in=w11) -> (tag out=w12, value=w13, error out=w14)
      append w13 to w7
    }
    call "Close Tag (Single).gvi"(tag=w12, error in=w14) -> (error out=w15)
    call "Close Configuration.gvi"(configuration=w1, error in=w15) -> (error out=w16)
    $"error out_2" <- w16
    Array Index(array=w7) -> (out0[_]=w17, out1[_]=w18, out2[_]=w19)
    $"Panel tilt angle, º" <- w17
    $"Intensity, W/m2" <- w18
    $"Temperature, ºC" <- w19
    Array Size(array=w7)
    call "Open Configuration.gvi"(server url="http://localhost:80", username="admin", password="w", error in=$"error in_3") -> (configuration=w20, error out=w21)
    call "Query Tags.gvi"(paths=["angle control", "light control", ""], error in=w21, configuration=w20) -> (tags=w22, error out=w23)
    Build Array($"Solar panel tilt angle, º", $"Power setting for the light source, W") -> w24
    for {
      w25 = each element of w22
      w26 = each element of w24
      Wait(time to wait=400)
      Property Node(instance in=w25) -> ("Path"=w27, "Datatype"=w28)
      call "Open Tag.gvi"(path=w27, data type=w28, error in=w23, configuration=w20) -> (tag=w29, error out=w30)
      call "Write Tag (DBL).gvi"(tag in=w29, value=w26, error in=w30) -> (tag out=w31, error out=w32)
    }
    call "Close Tag (Single).gvi"(tag=w31, error in=w32) -> (error out=w33)
    call "Close Configuration.gvi"(configuration=w20, error in=w33) -> (error out=w34)
    $"error out_3" <- w34
    stop if FALSE
  }
  sequence {
    frame 0 {
      call "Open Configuration.gvi"(server url="http://localhost:80/", username="admin", password="password") -> (configuration=w35, error out=w36)
      call "Open.gvi"(error in=w36, configuration=w35) -> (message session=w37, error out=w38)
    }
    frame 1 {
      s1 = w37  # shift register
      s2 = w38  # shift register
      while {
        call "Publish.gvi"(message session in=s1, topic="TopicName", message="New Message\n..................\n..................", error in=s2) -> (message session out=w39, error out=w40)
        next s1 = w39
        next s2 = w40
        stop if FALSE
      }
    }
    frame 2 {
      call "Flush.gvi"(message session in=s1, error in=s2) -> (error out=w41)
      call "Close Configuration.gvi"(configuration=w35, error in=w41)
    }
  }
  sequence {
    frame 0 {
      call "Open Configuration.gvi"(server url="http://localhost:80/", username="admin", password="password") -> (configuration=w42, error out=w43)
      call "Open.gvi"(error in=w43, configuration=w42) -> (message session=w44, error out=w45)
    }
    frame 1 {
      call "Subscribe.gvi"(message session in=w44, topic="TopicName", error in=w45) -> (message session out=w46, error out=w47)
    }
    frame 2 {
      s3 = w46  # shift register
      s4 = w47  # shift register
      while {
        call "Read.gvi"(message session in=s3, error in=s4) -> (message session out=w48, topic=w49, message=w50, error out=w51)
        sequence (after w49) (after w50) {
          frame 0 { }
        }
        next s3 = w48
        next s4 = w51
        stop if FALSE
      }
    }
    frame 3 {
      call "Unsubscribe.gvi"(message session in=s3, topic="TopicName", error in=s4) -> (message session out=w52, error out=w53)
    }
    frame 4 {
      call "Flush.gvi"(message session in=w52, error in=w53) -> (error out=w54)
      call "Close Configuration.gvi"(configuration=w42, error in=w54)
    }
  }
  call "Create All Message Queues.gvi"() -> (message queue=w55, error out=w56)
  while {
    event {
      on "Save in memory" Value changed {
        w57 = "Measurements/Save in Memory Buffer"  # Buttons WebVI
        call "Enqueue Message (Single).gvi"(message queue in=w55, message="", Enum=w57)
      }
      on "Slot number/Read/" Value changed {
        w58 = "Measurements/Read from Memory Buffer"  # Buttons WebVI
        call "Enqueue Message (Single).gvi"(message queue in=w55, message="", Enum=w58)
      }
      on "Clear Memory" Value changed {
        w59 = "Memory Buffer/Clear"  # Buttons WebVI
        call "Enqueue Message (Single).gvi"(message queue in=w55, message="", Enum=w59)
      }
      on "Clear All Memory" Value changed {
        w60 = "Memory Buffer/Clear all"  # Buttons WebVI
        call "Enqueue Message (Single).gvi"(message queue in=w55, message="", Enum=w60)
      }
      on "1000х" Value changed; "100х" Value changed; "10х" Value changed; "1х, Ohm" Value changed; "Manual/Automatic" Value changed {
        w61 = "Load Selection"  # Buttons WebVI/Measurments
        call "Enqueue Message (Single).gvi"(message queue in=w55, message="", Enum=w61)
      }
      on "Set Load" Value changed { }
      on "Slot number Tab 1" Value changed {
        w62 = "Calculations/Read Slot Memory"  # Buttons WebVI/Measurments
        call "Enqueue Message (Single).gvi"(message queue in=w55, message="", Enum=w62)
      }
      on "Calculate Tab 1" Value changed {
        w63 = "Calculation/Tab 1"  # Buttons WebVI/Measurments
        call "Enqueue Message (Single).gvi"(message queue in=w55, message="", Enum=w63)
      }
      on "Clear/ Tab 1" Value changed {
        w64 = "Clear/Tab 1"  # Buttons WebVI/Measurments
        call "Enqueue Message (Single).gvi"(message queue in=w55, message="", Enum=w64)
      }
      on "Calc/Slot number2.1" Value changed; "Calc/Slot number2.2" Value changed; "Calc/Slot number2.3" Value changed; "Calc/Slot number2.4" Value changed; "Show / Hide Graph 1" Value changed; "Show / Hide Graph 2" Value changed; "Show / Hide Graph 3" Value changed; "Show / Hide Graph 4" Value changed {
        w65 = "Calculation/Tab 2"  # Buttons WebVI/Measurments
        call "Enqueue Message (Single).gvi"(message queue in=w55, message="", Enum=w65)
      }
      on "Add to table Tab 4" Value changed {
        w66 = "Create Table/Tab 3"  # Buttons WebVI
        call "Enqueue Message (Single).gvi"(message queue in=w55, message="", Enum=w66)
      }
      on "Clear Table Tab 4" Value changed {
        w67 = "Clear Table/Tab 3"  # Buttons WebVI
        call "Enqueue Message (Single).gvi"(message queue in=w55, message="", Enum=w67)
      }
      on "Delete Last Tab 4" Value changed {
        w68 = "Delete Last Table/Tab 3"  # Buttons WebVI
        call "Enqueue Message (Single).gvi"(message queue in=w55, message="", Enum=w68)
      }
      on "Show Graph Tab 4" Value changed {
        call "Enqueue Message (Single).gvi"(message queue in=w55, message="", Enum="Show Chart")
      }
      on "Clear Graph Tab 4" Value changed {
        w69 = "Clear Chart"  # Buttons WebVI
        call "Enqueue Message (Single).gvi"(message queue in=w55, message="", Enum=w69)
      }
      on "Parameter X" Value changed; "Parameter Y" Value changed {
        w70 = "Header Tab 3"  # Buttons WebVI
        call "Enqueue Message (Single).gvi"(message queue in=w55, message="", Enum=w70)
      }
    }
    stop if FALSE
  }
  call "Open Configuration.gvi"(server url="", username="admin", password="test", error in=$"error in") -> (configuration=w71, error out=w72)
  call "Open Tag.gvi"(path="", data type="Double", error in=w72, configuration=w71) -> (tag=w73, error out=w74)
  while {
    call "Write Tag (DBL).gvi"(tag in=w73, value=0, error in=w74) -> (tag out=w75, error out=w76)
    stop if $Stop
  }
  call "Close Tag (Single).gvi"(tag=w75, error in=w76) -> (error out=w77)
  call "Close Configuration.gvi"(configuration=w71, error in=w77) -> (error out=w78)
  $"error out" <- w78
  while {
    call "Dequeue Message.gvi"(message queue in=w55, error in=w56) -> (message queue out=w79, message=w80, Enum=w81)
    case (w81) {
      frame "Initialize ", Default {
        call "Memory buffer.gvi"(Initialize/Max Number of slots memory=10, Command to buffer="Initialize") -> (Slot name indicator=w82)
        $"Memory Slot" <- w82
        w83 = "Initialize"  # Command Chart
        call "Custom Chart.gvi"(Command Graph=w83, X=0, Y=0) -> (Table out=w84, Chart=w85)
        $"Table Tab 4" <- w84
        Property Node(instance in=reference to "Slot number Tab 1", "Value"=10)
        $"Graph Tab 4" <- w85
        Property Node(instance in=reference to "Table/Measurment", "Value"=f64[][] [])
        Property Node(instance in=reference to "Slot name", "Value"="")
        Property Node(instance in=reference to "Graph Tab 1", "Value"=T1[] [])
        w86 = ["U, V", "I, A", "R, Ohm", "Angle, º", "J, W / m²", "T, ºC", "P,W", "ɳ,%"]
        $"Headers/Measurment" <- w86
        $"Headers/Calculation" <- w86
        Property Node(instance in=reference to "Table Measurments", "Value"=f64[][] [])
        w87 = "Update Display"  # Buttons WebVI
        call "Enqueue Message (Single).gvi"(message queue in=w79, message="Initialize", Enum=w87)
      }
      frame "Measurements/Save in Memory Buffer" {
        call "Memory buffer.gvi"(Number of slot=$"Slot Number", Command to buffer="Read") -> (Read/Slot=w88)
        Property Node(instance in=w88, "Slot name"=$"Slot Name", "Measurements"=$"Input Data") -> (instance out=w89)
        w90 = "Write"  # Command
        call "Memory buffer.gvi"(Buffer Data=w89, Number of slot=$"Slot Number", Command to buffer=w90) -> (Slot name indicator=w91, Read/Slot=w92)
        $"Memory Slot" <- w91
        Property Node(instance in=w92) -> ("Measurements"=w93)
        $"Table/Measurment" <- w93
        w94 = "Update Display"  # Buttons WebVI
        call "Enqueue Message (Single).gvi"(message queue in=w79, message="Data recording", Enum=w94)
      }
      frame "Measurements/Read from Memory Buffer" {
        w95 = "Read"  # Command
        call "Memory buffer.gvi"(Number of slot=$"Slot number/Read/", Command to buffer=w95) -> (Slot name indicator=w96, Read/Slot=w97)
        $"Memory Slot" <- w96
        Property Node(instance in=w97) -> ("Slot name"=w98, "Measurements"=w99)
        $"Read Slot Name" <- w98
        $"Table/Measurment" <- w99
        w100 = "Update Display"  # Buttons WebVI
        call "Enqueue Message (Single).gvi"(message queue in=w79, message="Reading From Memory Buffer", Enum=w100)
      }
      frame "Memory Buffer/Clear" {
        w101 = "Clear"  # Command
        call "Memory buffer.gvi"(Number of slot=$"Slot number/Read/", Command to buffer=w101) -> (Slot name indicator=w102, Read/Slot=w103)
        $"Memory Slot" <- w102
        Property Node(instance in=w103) -> ("Slot name"=w104, "Measurements"=w105)
        $"Read Slot Name" <- w104
        $"Table/Measurment" <- w105
        w106 = "Update Display"  # Buttons WebVI
        call "Enqueue Message (Single).gvi"(message queue in=w79, message="Deleting memory", Enum=w106)
      }
      frame "Memory Buffer/Clear all" {
        w107 = "Clear all"  # Command
        call "Memory buffer.gvi"(Number of slot=$"Slot number/Read/", Command to buffer=w107) -> (Slot name indicator=w108, Read/Slot=w109)
        $"Memory Slot" <- w108
        Property Node(instance in=w109) -> ("Slot name"=w110, "Measurements"=w111)
        $"Read Slot Name" <- w110
        $"Table/Measurment" <- w111
        w112 = "Update Display"  # Buttons WebVI
        call "Enqueue Message (Single).gvi"(message queue in=w79, message="Deleting all memory", Enum=w112)
      }
      frame "Load Selection" {
        case ($"Manual/Automatic") {
          frame "Manual", Default {
            Property Node(instance in=reference to "1000х", "Disabled"=FALSE)
            Property Node(instance in=reference to "100х", "Disabled"=FALSE)
            call "Load selection.gvi"(List box=reference to "100х", Value=[100, 200, 400, 500]) -> (Sum=w113)
            Property Node(instance in=reference to "10х", "Disabled"=FALSE) -> (instance out=w114)
            call "Load selection.gvi"(List box=w114, Value=[10, 20, 40, 50]) -> (Sum=w115)
            call "Load selection.gvi"(List box=reference to "1х, Ohm", Value=[1, 2, 4, 5]) -> (Sum=w116)
            call "Load selection.gvi"(List box=reference to "1000х", Value=[1000, 2000, 3000]) -> (Sum=w117)
            Add(w117, w113, w115, w116) -> w118
            $"Total Load, Ohm" <- w118
            Property Node(instance in=reference to "Set Load", "Disabled"=FALSE)
            Property Node(instance in=reference to "1х, Ohm", "Disabled"=FALSE)
            Property Node(instance in=reference to "Total Load, Ohm", "Disabled"=FALSE)
          }
          frame "Automatic" {
            Property Node(instance in=reference to "1000х", "Disabled"=TRUE)
            Property Node(instance in=reference to "100х", "Disabled"=TRUE)
            Property Node(instance in=reference to "10х", "Disabled"=TRUE)
            Property Node(instance in=reference to "Set Load", "Disabled"=TRUE)
            Property Node(instance in=reference to "1х, Ohm", "Disabled"=TRUE)
            Property Node(instance in=reference to "Total Load, Ohm", "Disabled"=TRUE)
          }
        }
        w119 = "Update Display"  # Buttons WebVI
        call "Enqueue Message (Single).gvi"(message queue in=w79, message="Load selection", Enum=w119)
      }
      frame "Set Load" { }
      frame "Calculations/Read Slot Memory" {
        w120 = "Read"  # Command
        call "Memory buffer.gvi"(Number of slot=$"Slot number Tab 1", Command to buffer=w120) -> (Read/Slot=w121)
        Property Node(instance in=w121) -> ("Slot name"=w122, "Measurements"=w123)
        $"Slot name" <- w122
        $"Table Measurments" <- w123
        w124 = "Update Display"  # Buttons WebVI
        call "Enqueue Message (Single).gvi"(message queue in=w79, message="Buffer memory-Tab1", Enum=w124)
      }
      frame "Calculation/Tab 1" {
        w125 = "Read"  # Command
        call "Memory buffer.gvi"(Number of slot=$"Slot number Tab 1", Command to buffer=w125) -> (Read/Slot=w126)
        Property Node(instance in=w126) -> ("Measurements"=w127)
        Array Index(array=w127) -> (out0[_, 0]=w128, out1[_, 1]=w129, out2[_, 4]=w130)
        Build Index And Bundle Cluster Array(w128, w129) -> (out=w131)
        Multiply(w128, w129) -> w132
        Build Index And Bundle Cluster Array(w128, w132) -> (out=w133)
        Build Cluster Array(w131, w133) -> (out=w134)
        $"Graph Tab 1" <- w134
        w135 = "Write"  # Command
        w136 = "Read"  # Command
        call "Memory buffer.gvi"(Number of slot=$"Slot number Tab 1", Command to buffer=w136) -> (Read/Slot=w137)
        w138 = 0.025  # Square Solar Panel
        Multiply(w130, w138) -> w139
        Divide(x=w132, y=w139) -> w140
        Multiply(w140, 100) -> w141
        Build Array(w132, w141) -> w142
        Transpose 2D Array(2D array=w142) -> (transposed array=w143)
        Property Node(instance in=w137, "Calculations "=w143) -> (instance out=w144)
        call "Memory buffer.gvi"(Buffer Data=w144, Number of slot=$"Slot number Tab 1", Command to buffer=w135) -> (Read/Slot=w145)
        call "Memory buffer.gvi"(Buffer Data=w145, Number of slot=$"Slot number Tab 1", Command to buffer="Read") -> (Read/Slot=w146)
        Property Node(instance in=w146) -> ("Measurements"=w147, "Calculations "=w148)
        Insert Into Array(inArray=w147, index1=6, new=w148) -> w149
        $"Table Measurments" <- w149
        w150 = "Update Display"  # Buttons WebVI
        call "Enqueue Message (Single).gvi"(message queue in=w79, message="Calculate Tab 1", Enum=w150)
      }
      frame "Clear/Tab 1" {
        Property Node(instance in=reference to "Graph Tab 1", "Value"=T1[] [])
        Property Node(instance in=reference to "Table Measurments", "Value"=f64[][] [])
        w151 = "Update Display"  # Buttons WebVI
        call "Enqueue Message (Single).gvi"(message queue in=w79, message="Clear Graph Tab 1", Enum=w151)
      }
      frame "Calculation/Tab 2" {
        Build Array($"Calc/Slot number2.1", $"Calc/Slot number2.2", $"Calc/Slot number2.3", $"Calc/Slot number2.4") -> w152
        Build Array($"Show / Hide Graph 1", $"Show / Hide Graph 2", $"Show / Hide Graph 3", $"Show / Hide Graph 4") -> w153
        for {
          w154 = each element of w153
          w155 = each element of w152
          case (w154) {
            frame False, Default {
              w162 = cluster{"Element 1": f64[], "Element 2": f64[]} {all zero or empty}
              w159 = default
              w160 = T1[] []
              w161 = w162
            }
            frame True {
              w163 = "Read"  # Command
              call "Memory buffer.gvi"(Number of slot=w155, Command to buffer=w163) -> (Read/Slot=w164)
              Property Node(instance in=w164) -> (instance out=w165)
              Property Node(instance in=w165) -> ("Measurements"=w166, "Calculations "=w167, "Slot name"=w159)
              Array Index(array=w166) -> (out0[_, 0]=w168, out1[_, 1]=w169, out2[_, 2]=w170)
              Build Index And Bundle Cluster Array(w168, w169) -> (out=w171)
              Array Index(array=w167) -> (out0[_, 0]=w172, out1[_, 1]=w173)
              Build Index And Bundle Cluster Array(w168, w172) -> (out=w174)
              Build Cluster Array(w171, w174) -> (out=w160)
              Build Cluster(w170, w173) -> w161
            }
          }
          append w159 to w156
          concatenate w160 onto w157
          append w161 to w158
        }
        $"Graph 1 Tab 3" <- w157
        Array Index(array=w156) -> (out0[_]=w175, out1[_]=w176, out2[_]=w177, out3[_]=w178)
        $"Slot name2.1" <- w175
        $"Slot name2.2" <- w176
        $"Slot name2.3" <- w177
        $"Slot name2.4" <- w178
        $"Graph 2 Tab 3" <- w158
        w179 = "Update Display"  # Buttons WebVI
        call "Enqueue Message (Single).gvi"(message queue in=w79, message="Calculation Tab 2", Enum=w179)
      }
      frame "Header Tab 3" {
        Property Node(instance in=reference to "Parameter X") -> ("Items"=w180, "Value"=w181)
        Array Index(array=w180) -> (out0[w181]=w182)
        Property Node(instance in=reference to "Parameter Y") -> ("Items"=w183, "Value"=w184)
        Array Index(array=w183) -> (out0[w184]=w185)
        Build Array(w182, w185) -> w186
        $"Header XY" <- w186
      }
      frame "Create Table/Tab 3" {
        w187 = "Write/Read "  # Command Chart
        call "Custom Chart.gvi"(Command Graph=w187, X=$X, Y=$Y) -> (Table out=w188)
        $"Table Tab 4" <- w188
        w189 = "Update Display"  # Buttons WebVI
        call "Enqueue Message (Single).gvi"(message queue in=w79, message="Crate Table Tab 3", Enum=w189)
      }
      frame "Clear Table/Tab 3" {
        w190 = "Clear Table"  # Command Chart
        call "Custom Chart.gvi"(Command Graph=w190, X=$X, Y=$Y) -> (Table out=w191)
        $"Table Tab 4_2" <- w191
      }
      frame "Delete Last Table/Tab 3" {
        w192 = "Delete last"  # Command Chart
        call "Custom Chart.gvi"(Command Graph=w192, X=$X, Y=$Y) -> (Table out=w193)
        $"Table Tab 4" <- w193
      }
      frame "Show Chart" {
        call "Custom Chart.gvi"(Command Graph="Graph", X=$X, Y=$Y) -> (Chart=w194)
        $"Graph Tab 4" <- w194
      }
      frame "Clear Chart" {
        w195 = "Clear Chart"  # Command Chart
        call "Custom Chart.gvi"(Command Graph=w195, X=$X, Y=$Y) -> (Chart=w196)
        $"Graph Tab 4" <- w196
      }
      frame "Update Display" {
        $"Update Display" <- w80
      }
    }
    stop if FALSE
  }
